# Dynamo graph AS Expo2JSON.dyn "AS Expo2JSON2" (Dynamo 2.13.1.3887)

code_block = CodeBlock()
# ---------- code_block.designscript (43 lines) ----------
def GetMark(list,t1,t2)
{
	//single part prefix
	sppProperty = Property.GetObjectProperty(list, t1);
	spPrefix = Property.Value(sppProperty);
	//single part mark
	spmProperty = Property.GetObjectProperty(list, t2);
	spMark = Property.Value(spmProperty);
	sp_value = spPrefix+spMark;
	return sp_value;
};

def ConvPlaToKey(obj)
{
	//Get property for the steel object
	ctPt = Property.GetObjectProperty(obj, "CenterPoint");
	pt = Property.Value(ctPt);
	x = Point.X(pt);
	y = Point.Y(pt);
	z = Point.Z(pt);
	//double to string then to key
	str_x = String.Substring(x+"", 0, 8);
	str_y = String.Substring(y+"", 0, 8);
	str_z = String.Substring(z+"", 0, 8);
	XYZ_key = str_x+str_y+str_z;
	return XYZ_key;
};

def ConvBeamToKey(obj)
{
	//Get property for the steel object
	CoorSys = Property.GetObjectProperty(obj, "Coordinate System at Physical Mid");
	pt = CoordinateSystem.Origin(Property.Value(CoorSys));
	x = Point.X(pt);
	y = Point.Y(pt);
	z = Point.Z(pt);
	//double to string then to key
	str_x = String.Substring(x+"", 0, 8);
	str_y = String.Substring(y+"", 0, 8);
	str_z = String.Substring(z+"", 0, 8);
	XYZ_key = str_x+str_y+str_z;
	return XYZ_key;
};
# ----------------------------------------
getSteelObjectsByType = ASSelectObjecTypes("Plate")
getSteelObjectsByType_2 = ASSelectObjecTypes("Straight Beam")
code_block_2 = CodeBlock(l1=getSteelObjectsByType, l2=getSteelObjectsByType_2)
# ---------- code_block_2.designscript (7 lines) ----------
list = List.Join([l1,l2]);
//key
ConvObjToKey(list);
// two values
sp_mark = GetMark(list,"SinglePart Prefix","SinglePart Number");
as_mark = GetMark(list,"MainPart Prefix","MainPart Number");
value = List.AddItemToEnd(sp_mark@L1<1>, as_mark@L1<1>);
# ----------------------------------------
byKeysValues = DesignScript.Builtin.Dictionary.ByKeysValues(keys=code_block_2.list, values=code_block_2.as_mark)
python_script = Python(IN[0]=byKeysValues)  # CPython3
# ---------- python_script.python (24 lines) ----------
# Load the Python Standard and DesignScript Libraries
# -*- coding: utf-8 -*-
import sys
import clr
import json 
clr.AddReference('ProtoGeometry')
from Autodesk.DesignScript.Geometry import *

# The inputs to this node will be stored as a list in the IN variables.
dataEnteringNode = IN

data = IN[0]

# Place your code below this line

jsonfile = json.dumps(data, indent=4)

with open(r'C:\Users\6321011\Desktop\JSON.txt', 'w') as f:
    f.write(jsonfile)

#open and read the file after the appending:

# Assign your output to the OUT variable.
OUT = jsonfile
# ----------------------------------------
straightBeamProperties = ASPropertiesStraightBeam("Coordinate System at Physical Mid")
code_block_3 = CodeBlock()
# ---------- code_block_3.designscript (16 lines) ----------
//function for define plates or beams
def ConvObjToKey(obj)
{
	return = [Imperative]

	{
		if (DSCore.Object.Type(obj) == "AdvanceSteel.Nodes.Plates.Plate")
			{
			return ConvPlaToKey(obj);
			}
		else
			{
			return ConvBeamToKey(obj);
			}
	}
};
# ----------------------------------------
